# Dynamo graph HackGlass_1H.dyn (Dynamo 1.3.1.1736)

categories = Categories("CurtainWallPanels")
all_elements_of_category = ElementsOfCategory(categories)
geometry = Element.Geometry(all_elements_of_category)
getMaterials = Element.GetMaterials(element=all_elements_of_category)
get_element_room_parameter_from = Custom[Get Element Room parameter from API]()  # unwired: Phase_string, Elements
lunchbox_room_element_collector = Custom[LunchBox Room Element Collector]()  # Collects rooms from the Revit document; unwired: Toggle
area = Room.Area()  # unwired: arg0
collect_rooms_and_spaces = Custom[Collect Rooms and Spaces]()  # Collect rooms and MEP spaces in the Revit document. Use "Rooms to HBZones" node to convert them to Honeybee zones.
get_rooms_by_level = Custom[Get Rooms by Level]()  # Filters Rooms by level.; unwired: Level, Exclude_Unplaced
doors = Custom[Room.Doors]()  # Retrieves all doors that are associated with a room (hosted in walls and roofs).; unwired: room, phase
parameterType = Parameter.ParameterType()  # unwired: arg0
select_model_element = DSModelElementSelection()
get_type_parameter = Custom[Get Type Parameter](element=select_model_element)  # This node will retrieve a type parameter by its name.; unwired: parameterName
duplicate_item_indices = Custom[Duplicate Item Indices]()  # Searches an input list for duplicate entries and lists their index numbers. Couple with Get From List to delete duplicates from a list.; unwired: List
wallType = Custom[Wall.WallType]()  # Queries the wall type of the input wall. Works for types from linked documents as well.; unwired: wall_s
orientation = Custom[Wall.Orientation]()  # Gets the orientation of a given wall instance (normal of the exterior face of the wall). Will *not* work for walls hosted on mass faces or in-place walls.; unwired: wall
get_host_element = Custom[Get Host Element]()  # This node will retrieve a host element from hosted element. Ex. feed in door, get wall.; unwired: hostedElement
categories_2 = Categories("Walls")
all_elements_of_category_2 = ElementsOfCategory(categories_2)
code_block = CodeBlock { "Comments"; }
getParameterValueByName = Element.GetParameterValueByName(element=all_elements_of_category_2, parameterName=code_block)
code_block_2 = CodeBlock { "EXT"; }
eq = getParameterValueByName == code_block_2
filterByBoolMask = List.FilterByBoolMask(list=all_elements_of_category_2, mask=eq)
ratio = Custom[Window.Wall.Ratio](Walls=filterByBoolMask.in)  # Facade window to wall ratio calculation; unwired: CurtainWall, Windows, Doors, Misc
categories_3 = Categories("Rooms")
all_elements_of_category_3 = ElementsOfCategory(categories_3)
code_block_3 = CodeBlock { "Occupant"; }
getParameterValueByName_2 = Element.GetParameterValueByName(element=all_elements_of_category_3, parameterName=code_block_3)
code_block_4 = CodeBlock { "EXT"; }
eq_2 = getParameterValueByName_2 == code_block_4
filterByBoolMask_2 = List.FilterByBoolMask(list=all_elements_of_category_3, mask=eq_2)
code_block_5 = CodeBlock { "Number"; }
getParameterValueByName_3 = Element.GetParameterValueByName(element=filterByBoolMask_2.in, parameterName=code_block_5)

# group: Here is list of EXT rooms ordered by number
sortByKey = List.SortByKey(list=filterByBoolMask_2.in, keys=getParameterValueByName_3)

parameters = Element.Parameters(sortByKey.sorted_list)

# group: to get walls assoc to rooms -but duplicates ext wall
boundaries = Custom[Room.Boundaries](Area=sortByKey.sorted_list)  # This node returns all Room bounding curves and elements that generated them (walls, separation lines etc).

uniqueItems = List.UniqueItems(boundaries.Element, lacing=Longest)
type = Custom[Element.Type](element=uniqueItems, lacing=Longest)  # Gets the family type of a given element (if applicable).
code_block_6 = CodeBlock { "Function"; }
getParameterValueByName_4 = Element.GetParameterValueByName(element=type, parameterName=code_block_6)

# group: 'EXT' filters out floors clgs and int walls
code_block_7 = CodeBlock { 1; }

eq_3 = getParameterValueByName_4 == code_block_7

# group: cleaned ordered ext walls
filterByBoolMask_3 = List.FilterByBoolMask(list=uniqueItems, mask=eq_3)

geometry_2 = Element.Geometry(filterByBoolMask_3.in)
geometry_3 = Element.Geometry(sortByKey.sorted_list)
get_categories_with_builtins = Custom[Get Categories with Builtins]()  # Lists: Category Names, internal api definition, Built In Category Names, Ids
get_builtinparameter_name = ItemSelector()  # unwired: arg0
builtInParameters = Custom[Document.BuiltInParameters]()  # List all the available BuiltInParameters
mergeByBoolMask = Custom[List.MergeByBoolMask]()  # Merge two lists by a boolean mask list. The true count in the mask should be the same as the length of the true list and vice versa for the false list.; unwired: mask, trueList, falseList
differenceAll = Solid.DifferenceAll()  # unwired: arg0, arg1
intersect = Geometry.Intersect()  # unwired: geometry, other
element_types = ElementTypes("ReferencePlane")
all_elements_of_type = ElementsOfType(element_types)
area_2 = Solid.Area()  # unwired: arg0
area_3 = Surface.Area()  # unwired: arg0

# group: Select rooms
geometry_4 = Element.Geometry(sortByKey.sorted_list)

watch = Watch(geometry_4)
faces = Topology.Faces(watch)
surfaceGeometry = Face.SurfaceGeometry(faces)
code_block_8 = CodeBlock { 0; }
normalAtParameter = Surface.NormalAtParameter(surface=surfaceGeometry, u=code_block_8, v=code_block_8)

# group: Select ext wall
geometry_5 = Element.Geometry(filterByBoolMask_3.in)

watch_2 = Watch(geometry_5)
faces_2 = Topology.Faces(watch_2)
surfaceGeometry_2 = Face.SurfaceGeometry(faces_2)
area_4 = Surface.Area(surfaceGeometry_2)
sortByKey_2 = List.SortByKey(list=surfaceGeometry_2@L2, keys=area_4@L2)
lastItem = List.LastItem(sortByKey_2.sorted_list@L2)
code_block_9 = CodeBlock { 0; }
normalAtParameter_2 = Surface.NormalAtParameter(surface=lastItem, u=code_block_9, v=code_block_9)
isParallel = Vector.IsParallel(normalAtParameter, normalAtParameter_2)
filterByBoolMask_4 = List.FilterByBoolMask(list=surfaceGeometry, mask=isParallel)
watch_3 = Watch(filterByBoolMask_4.in)
watch_4 = Watch(lastItem)
closestTo = Custom[Geometry.ClosestTo](geometry=watch_3, other=watch_4)  # Finds the closest entity in a list of geometric entities from another given entity
pointAtParameter = Surface.PointAtParameter(surface=closestTo.ClosestObject)
orientation_2 = Custom[Wall.Orientation]()  # unwired: wall
file_path = Filename(".\WinWallPercent.xlsx")
code_block_10 = CodeBlock { "Sheet1"; }
code_block_11 = CodeBlock { 0; }
code_block_12 = CodeBlock { "Level"; }
code_block_13 = CodeBlock { "Room Number"; }
code_block_14 = CodeBlock { "Wall Area Total"; }
code_block_15 = CodeBlock { "Window Area"; }
code_block_16 = CodeBlock { "% Glazing"; }
create = List.Create(code_block_12, code_block_13, code_block_14, code_block_15, code_block_16)
create_2 = List.Create(create)
code_block_17 = CodeBlock { "Level"; }
getParameterValueByName_5 = Element.GetParameterValueByName(element=sortByKey.sorted_list, parameterName=code_block_17)
area_5 = Surface.Area(closestTo.ClosestObject)
flatten = Flatten(area_5)
code_block_18 = CodeBlock { 0; }
count = Count(filterByBoolMask_2.in)
ofRepeatedItem = List.OfRepeatedItem(item=code_block_18, amount=count)
getKeys = GetKeys(filterByBoolMask_2.in)
select_phase = RevitPhases("New Construction")

# group: to get windows assoc to rooms
windows = Custom[Room.Windows](room=sortByKey.sorted_list, phase=select_phase)  # Retrieves all windows that are associated with a room (hosted in walls and roofs).

isEmpty = List.IsEmpty(windows@L2)
filterByBoolMask_5 = List.FilterByBoolMask(list=getKeys, mask=isEmpty)

# group: remove empty lists of windows
filterByBoolMask_6 = List.FilterByBoolMask(list=windows, mask=isEmpty)

code_block_19 = CodeBlock { "Area"; }
getParameterValueByName_6 = Element.GetParameterValueByName(element=filterByBoolMask_6.out, parameterName=code_block_19)

# group: add windows per room
sum = Math.Sum(getParameterValueByName_6@L2)

# group: Window Areas -add zeroes where empty lists were
replaceItemAtIndex = Custom[List.ReplaceItemAtIndex+](seq=ofRepeatedItem, index=filterByBoolMask_5.out, replacement=sum)  # Replaces the item at a given index (or list of indices) of a list by another item

div = replaceItemAtIndex / area_5
code_block_20 = CodeBlock { 100; }
mul = div * code_block_20
create_3 = List.Create(getParameterValueByName_5, getParameterValueByName_3, flatten, replaceItemAtIndex, mul)
transpose = List.Transpose(create_3)
join = List.Join(create_2, transpose)
boolean = BoolSelector(true)
writeToFile = Excel.WriteToFile(filePath=file_path, sheetName=code_block_10, startRow=code_block_11, startCol=code_block_11, data=join, overWrite=boolean)
code_block_21 = CodeBlock { "Orientation"; }
northSouthEastWest = Custom[Wall.NorthSouthEastWest]()  # This node determines which direction a wall is facing and groups them by the direction or direction they are closest to.; unwired: Wall, Normals
