# Dynamo graph HackGlass_1K.dyn (Dynamo 1.3.1.1736)

categories = Categories("Rooms")
all_elements_of_category = ElementsOfCategory(categories)
code_block = CodeBlock { "Occupant"; }
getParameterValueByName = Element.GetParameterValueByName(element=all_elements_of_category, parameterName=code_block)
code_block_2 = CodeBlock { "EXT"; }
eq = getParameterValueByName == code_block_2
filterByBoolMask = List.FilterByBoolMask(list=all_elements_of_category, mask=eq)
code_block_3 = CodeBlock { "Number"; }
getParameterValueByName_2 = Element.GetParameterValueByName(element=filterByBoolMask.in, parameterName=code_block_3)

# group: Here is list of EXT rooms ordered by number
sortByKey = List.SortByKey(list=filterByBoolMask.in, keys=getParameterValueByName_2)

geometry = Element.Geometry(sortByKey.sorted_list)

# group: Enter Path to Excel File
file_path = Filename(".\WinWallPercent.xlsx")

code_block_4 = CodeBlock { "Sheet1"; }
code_block_5 = CodeBlock { 0; }
code_block_6 = CodeBlock { "Level"; }
code_block_7 = CodeBlock { "Room Number"; }
code_block_8 = CodeBlock { "Wall Area Total"; }
code_block_9 = CodeBlock { "Window Area"; }
code_block_10 = CodeBlock { "% Glazing"; }
create = List.Create(code_block_6, code_block_7, code_block_8, code_block_9, code_block_10)
create_2 = List.Create(create)
code_block_11 = CodeBlock { "Level"; }
getParameterValueByName_3 = Element.GetParameterValueByName(element=sortByKey.sorted_list, parameterName=code_block_11)

# group: Select rooms
geometry_2 = Element.Geometry(sortByKey.sorted_list)

faces = Topology.Faces(geometry_2)
surfaceGeometry = Face.SurfaceGeometry(faces)
code_block_12 = CodeBlock { 0; }
normalAtParameter = Surface.NormalAtParameter(surface=surfaceGeometry, u=code_block_12, v=code_block_12)

# group: Archi-lab - to get walls assoc to rooms -but duplicates ext wall
boundaries = Custom[Room.Boundaries](Area=sortByKey.sorted_list)  # This node returns all Room bounding curves and elements that generated them (walls, separation lines etc).

uniqueItems = List.UniqueItems(boundaries.Element, lacing=Longest)

# group: Rhythm node
type = Custom[Element.Type](element=uniqueItems, lacing=Longest)  # Gets the family type of a given element (if applicable).

code_block_13 = CodeBlock { "Function"; }
getParameterValueByName_4 = Element.GetParameterValueByName(element=type, parameterName=code_block_13)

# group: 'EXT' filters out floors clgs and int walls
code_block_14 = CodeBlock { 1; }

eq_2 = getParameterValueByName_4 == code_block_14

# group: cleaned ordered ext walls
filterByBoolMask_2 = List.FilterByBoolMask(list=uniqueItems, mask=eq_2)

# group: Select ext wall
geometry_3 = Element.Geometry(filterByBoolMask_2.in)

faces_2 = Topology.Faces(geometry_3)
surfaceGeometry_2 = Face.SurfaceGeometry(faces_2)
area = Surface.Area(surfaceGeometry_2)
sortByKey_2 = List.SortByKey(list=surfaceGeometry_2@L2, keys=area@L2)
lastItem = List.LastItem(sortByKey_2.sorted_list@L2)
code_block_15 = CodeBlock { 0; }
normalAtParameter_2 = Surface.NormalAtParameter(surface=lastItem, u=code_block_15, v=code_block_15)
isParallel = Vector.IsParallel(normalAtParameter, normalAtParameter_2)
filterByBoolMask_3 = List.FilterByBoolMask(list=surfaceGeometry, mask=isParallel)
closestTo = Custom[Geometry.ClosestTo](geometry=filterByBoolMask_3.in, other=lastItem)  # Finds the closest entity in a list of geometric entities from another given entity
area_2 = Surface.Area(closestTo.ClosestObject)
flatten = Flatten(area_2)
code_block_16 = CodeBlock { 0; }
count = Count(filterByBoolMask.in)
ofRepeatedItem = List.OfRepeatedItem(item=code_block_16, amount=count)
getKeys = GetKeys(filterByBoolMask.in)
select_phase = RevitPhases("New Construction")

# group: Clockwork - to get windows assoc to rooms
windows = Custom[Room.Windows](room=sortByKey.sorted_list, phase=select_phase)  # Retrieves all windows that are associated with a room (hosted in walls and roofs).

isEmpty = List.IsEmpty(windows@L2)
filterByBoolMask_4 = List.FilterByBoolMask(list=getKeys, mask=isEmpty)

# group: remove empty lists of windows
filterByBoolMask_5 = List.FilterByBoolMask(list=windows, mask=isEmpty)

code_block_17 = CodeBlock { "Area"; }
getParameterValueByName_5 = Element.GetParameterValueByName(element=filterByBoolMask_5.out, parameterName=code_block_17)

# group: add windows per room
sum = Math.Sum(getParameterValueByName_5@L2)

# group: Clockwork node Window Areas -add zeroes where empty lists were
replaceItemAtIndex = Custom[List.ReplaceItemAtIndex+](seq=ofRepeatedItem, index=filterByBoolMask_4.out, replacement=sum)  # Replaces the item at a given index (or list of indices) of a list by another item

div = replaceItemAtIndex / area_2
code_block_18 = CodeBlock { 100; }
mul = div * code_block_18
flatten_2 = Flatten(mul)
create_3 = List.Create(getParameterValueByName_3, getParameterValueByName_2, flatten, replaceItemAtIndex, flatten_2)
transpose = List.Transpose(create_3)
join = List.Join(create_2, transpose)
boolean = BoolSelector(true)
writeToFile = Excel.WriteToFile(filePath=file_path, sheetName=code_block_4, startRow=code_block_5, startCol=code_block_5, data=join, overWrite=boolean)

# group: Exterior rooms need 'EXT' for 'Occupant' param.
code_block_19 = CodeBlock { "Notes"; }
