# Dynamo graph OrientationNormals.dyn (Dynamo 1.3.1.1736)

categories = Categories("Walls")
byCategory = Revit.Collector.ByCategory(categories)
orientation = Custom[Wall.Orientation](wall=byCategory)  # Gets the orientation of a given wall instance (normal of the exterior face of the wall). Will *not* work for walls hosted on mass faces or in-place walls.
northSouthEastWest = Custom[Wall.NorthSouthEastWest](Wall=byCategory, Normals=orientation)  # This node determines which direction a wall is facing and groups them by the direction or direction they are closest to.
watch = Watch(northSouthEastWest.North)
watch_2 = Watch(northSouthEastWest.West)
watch_3 = Watch(northSouthEastWest.East)
watch_4 = Watch(northSouthEastWest.South)
